vi "Main Window.gvi"   [LabVIEW NXG 5.0.0]
panel controls:
  "Main Tab": i32
  "Light Calibration Tab": i32
  "Start Wavelength (nm)": f64 = 300
  "End Wavelength (nm)": f64 = 900
  "Wavelength Step (nm)": f64 = 5
  "New Calibration": bool
  "Load Calibration": bool
  "Save Calibration": bool
  "Initialize App Bundle Cluster": "Initialize App Bundle Cluster.gtype"
  "Configuration Tab": i32
  "Abort Button": bool
  "Exit App Button": bool
  "Debugging Cluster": "Debugging Cluster.gtype"
  "Rainbow Measurement tab": i32
panel indicators:
  "Irradiance Calibration": f64[]
  "Light Power (W)": f64
  "Current Wavelength (nm)": f64
  "Current State": "Queue Instructions Control.gtype"
  "Current Sub State": string
  "Beam Power Density": f64[][]
types:
  "All Paths Cluster.gtype" = cluster{"Thorlabs Motor Serial Number File Path": path}
  "Instrument Coms Info.gtype" = cluster{"Arduino Coms Info": "Arduino Detection cluster control.gtype", "Photodetector Names": string[], "Keythley Address": "VISA Instr", "Photodetector Detected?": bool, "Thorlabs Motors Detected?": bool, "Keithley Detected?": bool, "Thorlabs Motors Serial Number": "Thorlabs Motors Serial Number In.gtype", "Photodetector IVI session": "Ivi IviDefault"}
  "Initialize App Bundle Cluster.gtype" = cluster{"All Paths": "All Paths Cluster.gtype", "Instrument Addresses": "Instrument Coms Info.gtype"}
  "Queue Instructions Control.gtype" = enum{"Undefined State", "Debug Check", "Initialize App", "Idle", "Light Calibration Irradiance", "Light Calibration Spectral Density", "Light Calibration Power Density", "Access TXT File", "Stop App"}
  "Debugging Cluster.gtype" = cluster{"Debugging mode?": bool, "Initialize App": bool}
uses:
  Rainbow Measurement Setup::Main Functions::Instruction Queue::Current State::FGV Current State.gvi
  Rainbow Measurement Setup::Main Functions::Debugging::Debugging Prompt.gvi
  Rainbow Measurement Setup::Main Functions::Initialize App::Initialize app subroutine.gvi
  Rainbow Measurement Setup::Side Functions::Global Abort::FGV Global Abort.gvi
  Rainbow Measurement Setup::Side Functions::Timeout Sequence.gvi
  Rainbow Measurement Setup::Side Functions::Exit App Sequence.gvi
  Rainbow Measurement Setup::Side Functions::Global Abort::Global Abort Sequence.gvi
  NI::G Core::Error::Multiplex Errors.gvi
  NI::G Core::Error::Display Error.gvi
diagram:
  call "FGV Current State.gvi"(Current State Instructions="Set Current State and Substate", Current State="Undefined State", Current Substate="Starting Up") -> (Error Out=w1)
  Obtain Queue(create if not found=TRUE, element data type="Queue Instructions Control.gtype" "Undefined State", error in=w1, name="Instruction Queue") -> (error out=w2, queue out=w3)
  Enqueue Element(element="Debug Check", error in=w2, queue=w3) -> (error out=w4, queue out=w5)
  s1 = w5  # shift register
  s2 = w4  # shift register
  while {
    # This is the consumer loop, it takes enqueued instructions and performs the ne required actions
    case (s2) {
      frame Error, Default {
        w6 = s2
        w7 = s1
        w8 = TRUE
      }
      frame No Error {
        Dequeue Element(error in=s2, queue=s1) -> (element=w9, error out=w10, queue out=w11)
        case (w9) {
          frame "Undefined State" {
            w6 = w10
            w7 = w11
            w8 = default
          }
          frame "Debug Check" {
            call "Debugging Prompt.gvi"(Debugging Cluster In=$"Debugging Cluster", Error In=w10) -> (Debugging Cluster Out=w12, Error Out=w13)
            $"Debugging Cluster" <- w12
            Enqueue Element(element="Initialize App", error in=w13, queue=w11) -> (error out=w6, queue out=w7)
            w8 = default
          }
          frame "Initialize App" {
            call "Initialize app subroutine.gvi"(Initialize App Bundle Cluster In=$"Initialize App Bundle Cluster", Error In=w10, Debugging Cluster=$"Debugging Cluster") -> (Initialize App Bundle Cluster Out=w14, Error Out=w15)
            $"Initialize App Bundle Cluster" <- w14
            Enqueue Element(element="Idle", error in=w15, queue=w11) -> (error out=w6, queue out=w7)
            w8 = default
          }
          frame "Idle", Default {
            call "FGV Global Abort.gvi"(Global Abort Instructions="Reset State", Error In=w10) -> (Error Out=w16)
            call "FGV Current State.gvi"(Current State Instructions="Set Current State and Substate", Current State="Idle", Current Substate="Idle", Error In=w16) -> (Error Out=w6)
            w7 = w11
            w8 = default
          }
          frame "Stop App" {
            call "FGV Current State.gvi"(Current State Instructions="Set Current State and Substate", Current State="Stop App", Current Substate="Bye Bye :D", Error In=w10) -> (Error Out=w6)
            w7 = w11
            w8 = TRUE
          }
        }
      }
    }
    Logical Or(w6, w8) -> w17
    next s1 = w7
    next s2 = w6
    stop if w17
  }
  # This is the main window it takes instructions from the main pannel introduced by the user and
  # performs the corresponding necessary actions
  s3 = w5  # shift register
  s4 = w4  # shift register
  while {
    # This is the producer loop that takes the commands and if possible enqueues them so that the
    # slave loop can perform the corresponding actions
    event (timeout = 500) {
      on "Timeout" {
        call "Timeout Sequence.gvi"(Error In=s4) -> (Current State Out=w21, Current SubState Out=w22, Stop App?=w20, Error Out=w19)
        $"Current State" <- w21
        $"Current Sub State" <- w22
        w18 = s3
      }
      on "Exit App Button" Value changed {
        call "Exit App Sequence.gvi"(Queue In=s3, Exit App=$"Exit App Button", Error In=s4) -> (Queue Out=w18, Error Out=w19)
        w20 = default
      }
      on "Abort Button" Value changed {
        call "Global Abort Sequence.gvi"(Queue In=s3, Global Abort=$"Abort Button", Error In=s4) -> (Queue Out=w18, Error Out=w19)
        w20 = default
      }
    }
    next s3 = w18
    next s4 = w19
    stop if w20
  }
  Flush Queue(error in=s4, queue=s3) -> (error out=w23, queue out=w24)
  Release Queue(error in=w23, queue=w24) -> (error out=w25)
  call "Multiplex Errors.gvi"(error in 1=s2, error in 2=w25) -> (error out=w26)
  case (w26) {
    frame Error, Default {
      # In case there is an error
      # put out an error handler
      call "Display Error.gvi"(error in=w26)
    }
    frame No Error { }
  }
